# Grasshopper definition capture point offset_final.gh (Grasshopper 1.0.8)
# plug-ins: RhinoCodePluginGH

# 斑马线
curve = Curve([<curve referenced from the Rhino model> x2221])
# 速度更快（对比较常规的点也是正确的）
# 输入端
# 道路中心点
point = Point([<point referenced from the Rhino model> x680])
# 路网与斑马线交点
point_2 = Point([<point referenced from the Rhino model> x2120])
# 断开道路中心线
curve_2 = Curve([<curve referenced from the Rhino model> x4704])
# 更准确（对待复杂路口和点也可以精确生成）
# 输入端
# 道路中心点
point_3 = Point([<point referenced from the Rhino model> x2])
# 斑马线
curve_3 = Curve([<curve referenced from the Rhino model> x63])
# 路网与斑马线交点
point_4 = Point([<point referenced from the Rhino model> x57])
# 断开道路中心线
curve_4 = Curve([<curve referenced from the Rhino model> x146])
# 连续道路中心线
curve_5 = Curve([<curve referenced from the Rhino model> x76])
python_3_script = Python3Script(intersection_points=point_2, centerlines=curve_2, crosswalks=curve)  # -> a; inputs intersection_points: list of Point3d, centerlines: list of Curve, crosswalks: list of Curve; disabled
# ---------- python_3_script: Python ----------
import rhinoscriptsyntax as rs
import Grasshopper as gh


def find_matching_curves(intersection_points, centerlines, crosswalks):
    result_tree = gh.DataTree[object]()

    for i, point in enumerate(intersection_points):
        centerline_match = None
        crosswalk_match = None

        # 查找与点相交的中心线
        for centerline in centerlines:
            param = rs.CurveClosestPoint(centerline, point)
            closest_point = rs.EvaluateCurve(centerline, param)
            if rs.Distance(point, closest_point) < 1e-6:
                centerline_match = centerline
                break

        # 查找与点相交的斑马线
        for crosswalk in crosswalks:
            param = rs.CurveClosestPoint(crosswalk, point)
            closest_point = rs.EvaluateCurve(crosswalk, param)
            if rs.Distance(point, closest_point) < 1e-6:
                crosswalk_match = crosswalk
                break

        # 若都找到匹配的曲线，则添加到结果树
        if centerline_match and crosswalk_match:
            path = gh.Kernel.Data.GH_Path(i)
            result_tree.Add(point, path)
            result_tree.Add(centerline_match, path)
            result_tree.Add(crosswalk_match, path)

    return result_tree


# Grasshopper 输入变量
# intersection_points 是路网中心线与斑马线交汇的点集
# centerlines 是路网中心线集
# crosswalks 是斑马线集
# 输出变量为 result
result = find_matching_curves(intersection_points, centerlines, crosswalks)

# 赋值给 Grasshopper 输出
a = result
# ---------- end python_3_script ----------
python_3_script_2 = Python3Script(intersection_points=point_4, centerlines=curve_4, crosswalks=curve_3)  # -> a; inputs intersection_points: list of Point3d, centerlines: list of Curve, crosswalks: list of Curve; disabled; same code as python_3_script
list_item = ListItem(List=python_3_script, Index=0, Wrap=True)  # disabled
number_slider = Slider(75, range=0..100)  # disabled
list_item_2 = ListItem(List=python_3_script_2, Index=0, Wrap=True)  # disabled
point_5 = Point(list_item)  # disabled
python_3_script_3 = Python3Script(a=python_3_script)  # -> junction, center, cross; inputs a: tree; disabled
# ---------- python_3_script_3: Python ----------
import Grasshopper as gh

# 假设输入参数为 a，即上一个 Python 电池的输出
points = gh.DataTree[object]()
centerlines = gh.DataTree[object]()
crosswalks = gh.DataTree[object]()

# 遍历输入的树状数据
for i in range(a.BranchCount):
    branch = a.Branch(i)
    if len(branch) == 3:
        point = branch[0]
        centerline = branch[1]
        crosswalk = branch[2]

        path = gh.Kernel.Data.GH_Path(i)
        points.Add(point, path)
        centerlines.Add(centerline, path)
        crosswalks.Add(crosswalk, path)

# 赋值给 Grasshopper 输出
junction = points
center = centerlines
cross = crosswalks
# ---------- end python_3_script_3 ----------
point_6 = Point(list_item_2)  # disabled
# （数据结构转换）
# 与道路中心点配对
python_3_script_4 = Python3Script(center=graft(point), corner=flatten(point_5), radius=number_slider)  # -> simplify(nearby); inputs center: list of Point3d, corner: list of Point3d, radius: Int32; disabled
# ---------- python_3_script_4: Python ----------
import Rhino.Geometry as rg
import math


# 初始化结果列表（每个元素对应点集A中一个点的邻近点列表）
result = []

for pt_a in center:
    nearby = []  # 当前圆心点pt_a的邻近点列表
    for pt_b in corner:
        # 计算两点之间的欧氏距离
        dx = pt_a.X - pt_b.X
        dy = pt_a.Y - pt_b.Y
        dz = pt_a.Z - pt_b.Z
        distance = math.sqrt(dx**2 + dy**2 + dz**2)
        
        if distance <= radius:
            nearby.append(pt_b)
    
    result.append(nearby)

# 输出结果：每个点对应的邻近点列表
out = result
# ---------- end python_3_script_4 ----------
python_3_script_5 = Python3Script(a=python_3_script_2)  # -> junction, center, cross; inputs a: tree; disabled; same code as python_3_script_3
# （数据结构转换）
# 与道路中心点配对
python_3_script_6 = Python3Script(center_points=point_3, curves=curve_5, nearby_points=point_6)  # -> a; inputs center_points: list of Point3d, curves: list of Curve, nearby_points: list of Point3d; disabled
# ---------- python_3_script_6: Python ----------
import rhinoscriptsyntax as rs
import Grasshopper as gh


def find_points_on_intersecting_curves(center_points, curves, nearby_points):
    # 检查输入是否为 None
    if center_points is None or curves is None or nearby_points is None:
        return gh.DataTree[object]()

    result_tree = gh.DataTree[object]()
    tolerance = rs.UnitAbsoluteTolerance()  # 使用 Rhino 的绝对公差

    for i, center_point in enumerate(center_points):
        intersecting_curves = []
        # 找到与中心点相交的所有曲线
        for curve in curves:
            # 计算点到曲线的最近点
            param = rs.CurveClosestPoint(curve, center_point)
            closest_point = rs.EvaluateCurve(curve, param)
            # 判断点是否在曲线上，使用 Rhino 的绝对公差
            if rs.Distance(center_point, closest_point) < tolerance:
                intersecting_curves.append(curve)

        # 存储在相交曲线上的附近点
        points_on_curves = []
        for curve in intersecting_curves:
            for nearby_point in nearby_points:
                # 计算点到曲线的最近点
                param = rs.CurveClosestPoint(curve, nearby_point)
                closest_point = rs.EvaluateCurve(curve, param)
                # 判断点是否在曲线上，使用 Rhino 的绝对公差
                if rs.Distance(nearby_point, closest_point) < tolerance:
                    points_on_curves.append(nearby_point)

        # 将结果添加到树中
        path = gh.Kernel.Data.GH_Path(i)
        result_tree.AddRange(points_on_curves, path)

    return result_tree


# Grasshopper 输入变量
# center_points 是路网中心点集
# curves 是路网曲线集
# nearby_points 是中心点附近的点集
# 输出变量为 result
result = find_points_on_intersecting_curves(center_points, curves, nearby_points)

# 赋值给 Grasshopper 输出
a = result
# ---------- end python_3_script_6 ----------

curve_6 = Curve(python_3_script_3.cross)  # disabled
curve_7 = Curve(python_3_script_3.center)  # disabled

point_7 = Point(flatten(python_3_script_4))  # disabled

curve_8 = Curve(python_3_script_5.cross)  # disabled
curve_9 = Curve(python_3_script_5.center)  # disabled

point_8 = Point(flatten(python_3_script_6))  # disabled

# ----
# 中心点-斑马线上点-斑马线上点对应的两条线
# 四者顺序对应
member_index = MemberIndex(Set=flatten(point_6), Member=point_8)  # -> simplify(Index), Count; disabled
list_item_3 = ListItem(List=flatten(curve_9), Index=flatten(member_index.Index), Wrap=True)  # disabled
list_item_4 = ListItem(List=flatten(curve_8), Index=flatten(member_index.Index), Wrap=True)  # disabled

# ----
# 中心点-斑马线上点-斑马线上点对应的两条线
# 四者顺序对应
member_index_2 = MemberIndex(Set=flatten(point_5), Member=point_7)  # -> simplify(Index), Count; disabled
list_item_5 = ListItem(List=flatten(curve_7), Index=flatten(member_index_2.Index), Wrap=True)  # disabled
list_item_6 = ListItem(List=flatten(curve_6), Index=flatten(member_index_2.Index), Wrap=True)  # disabled

# ----
# 向量计算
# 斑马线上的点在哪条斑马线
point_9 = Point(simplify(graft(point_3)))  # disabled
angle = Angle(VectorA=list_item_4, VectorB=list_item_3)  # -> Angle, Reflex; disabled
vector_2pt = Vector2Pt(PointA=point_9, PointB=python_3_script_6, Unitize=False)  # -> Vector, Length; disabled
python_3_script_7 = Python3Script(points=point_8, curves=curve_3)  # -> a; inputs points: list of Point3d, curves: list of Curve; disabled
# ---------- python_3_script_7: Python ----------
import rhinoscriptsyntax as rs
import Grasshopper as gh

def find_segment_for_each_point(points, curves):
    result_segments = []

    for point in points:
        found_segment = None
        for curve in curves:
            # 计算点到曲线的最近点
            param = rs.CurveClosestPoint(curve, point)
            closest_point = rs.EvaluateCurve(curve, param)
            # 判断点是否在曲线上
            if rs.Distance(point, closest_point) < 1e-6:
                found_segment = curve
                break

        result_segments.append(found_segment)

    return result_segments

# Grasshopper 输入变量
# points 是点集
# curves 是曲线集
# 输出变量为 result_segments
result_segments = find_segment_for_each_point(points, curves)

# 赋值给 Grasshopper 输出
a = result_segments
# ---------- end python_3_script_7 ----------
cosine = Cosine(Value=angle.Angle)  # disabled
number_slider_2 = Slider(0.667, range=0..1)  # disabled
absolute = Absolute(Value=cosine)  # disabled
length = Length(Curve=python_3_script_7)  # disabled
unit_vector = UnitVector(Vector=vector_2pt.Vector)  # -> flatten(Vector); disabled
multiplication = Multiplication(A=absolute, B=number_slider_2)  # disabled
multiplication_2 = Multiplication(A=multiplication, B=length)  # disabled
multiplication_3 = Multiplication(A=unit_vector, B=multiplication_2)  # disabled

# ----
# 向量计算
# 斑马线上的点在哪条斑马线
point_10 = Point(simplify(graft(point)))  # disabled
angle_2 = Angle(VectorA=list_item_6, VectorB=list_item_5)  # -> Angle, Reflex; disabled
vector_2pt_2 = Vector2Pt(PointA=point_10, PointB=python_3_script_4, Unitize=False)  # -> Vector, Length; disabled
python_3_script_8 = Python3Script(points=point_7, curves=curve)  # -> a; inputs points: list of Point3d, curves: list of Curve; disabled; same code as python_3_script_7
cosine_2 = Cosine(Value=angle_2.Angle)  # disabled
number_slider_3 = Slider(0.667, range=0..1)  # disabled
absolute_2 = Absolute(Value=cosine_2)  # disabled
length_2 = Length(Curve=python_3_script_8)  # disabled
unit_vector_2 = UnitVector(Vector=vector_2pt_2.Vector)  # -> flatten(Vector); disabled
multiplication_4 = Multiplication(A=absolute_2, B=number_slider_3)  # disabled
multiplication_5 = Multiplication(A=multiplication_4, B=length_2)  # disabled
multiplication_6 = Multiplication(A=unit_vector_2, B=multiplication_5)  # disabled

move = Move(Geometry=point_8, Motion=flatten(multiplication_3))  # -> Geometry, Transform; disabled
move_2 = Move(Geometry=point_7, Motion=flatten(multiplication_6))  # -> Geometry, Transform; disabled
# 输出端
point_11 = Point(move.Geometry)  # disabled
# 输出端
point_12 = Point(move_2.Geometry)  # disabled
