# Grasshopper definition capture point offset_try1.gh (Grasshopper 1.0.8)
# plug-ins: RhinoCodePluginGH, Kangaroo Components

# ---- group: 找到相交线并提取斑马线上的相交点
curve = Curve([<curve referenced from the Rhino model> x6])
curve_2 = Curve([<curve referenced from the Rhino model> x4])
python_3_script = Python3Script(lines=curve)  # -> out, a, b; inputs lines: list of Curve
# ---------- python_3_script: Python ----------
import rhinoscriptsyntax as rs
import Grasshopper as gh

def find_line_intersections(lines):
    # 初始化输出
    intersection_points = []  # 交点列表
    intersection_indices = gh.DataTree[object]()  # 交点对应的线段索引
    
    # 检查每对线段的相交情况
    for i in range(len(lines)):
        for j in range(i + 1, len(lines)):
            line1 = lines[i]
            line2 = lines[j]
            
            # 计算线段相交
            intersection = rs.LineLineIntersection(line1, line2)
            
            if intersection:
                # 获取交点（intersection返回起点到交点的参数）
                point = rs.AddPoint(intersection[0])
                
                # 检查交点是否重复
                is_duplicate = False
                for existing_pt in intersection_points:
                    if rs.Distance(point, existing_pt) < 1e-6:
                        is_duplicate = True
                        break
                
                if not is_duplicate:
                    intersection_points.append(point)
                    # 创建分支路径并添加对应的线段索引
                    path = gh.Kernel.Data.GH_Path(len(intersection_points) - 1)
                    intersection_indices.AddRange([i, j], path)
    
    return intersection_points, intersection_indices

# Grasshopper输入变量为 "lines"，类型为 Line
# 输出变量为 "points" 和 "indices"
points, indices = find_line_intersections(lines)

# 赋值给Grasshopper输出
a = points  # 交点列表
b = indices  # 交点对应的线段索引树
# ---------- end python_3_script ----------
panel = Panel(python_3_script.b)
end_points = EndPoints(Curve=curve_2)  # -> Start, End
list_item = ListItem(List=curve, Index=python_3_script.b, Wrap=True)
point = Point(python_3_script.a)
point_2 = Point([end_points.End, end_points.Start])
removeduplicatepts = RemoveDuplicatePts(Points=point_2, Tolerance=0.001)
python_3_script_2 = Python3Script(x=curve_2, y=point)  # -> out, dot_product; inputs x: list of Curve, y: list of Point3d
# ---------- python_3_script_2: Python ----------
import Rhino.Geometry as rg
import math

# 输入参数
lines = x  # 线段列表
points = y  # 点列表
tolerance = 0.001

# 确保 points 是列表格式
if isinstance(points, rg.Point3d):
    points = [points]

result_points = []

for p in points:
    for line in lines:
        a = line.PointAtStart  # 线段起点
        b = line.PointAtEnd    # 线段终点
        
        # 计算向量AP和AB
        ap = p - a
        ab = b - a
        
        # 计算点积
        dot_product = ap * ab
        
        # 计算向量的模长
        ap_length = ap.Length
        ab_length = ab.Length
        
        # 计算理论上的最大点积
        max_dot_product = ap_length * ab_length
        
        # 判断点积是否接近于最大点积
        if abs(dot_product - max_dot_product) <= tolerance * max_dot_product and ab_length > tolerance:
            # 判断点是否在线段AB之间（点积在0到AB²之间）
            dot_ab_sq = ab * ab
            if 0 <= dot_product <= dot_ab_sq:
                result_points.append(p)  # 存储找到的点
                break  # 找到后跳出线段循环，避免重复添加

# 输出结果
out = result_points
# ---------- end python_3_script_2 ----------
panel_2 = Panel(point)
panel_3 = Panel(list_item)
tree_branch = TreeBranch(Tree=list_item, Path=Slider(3, range=0..14), MaintainPaths=True)
set_difference = SetDifference(SetA=python_3_script_2.out, SetB=removeduplicatepts)
panel_4 = Panel(tree_branch)
list_item_2 = ListItem(List=tree_branch, Index=0, Wrap=True)  # -> Item, Item1
point_3 = Point(set_difference)
panel_5 = Panel(point_3)
curve_3 = Curve(list_item_2.Item1)
curve_4 = Curve(list_item_2.Item)

# ----
curve_5 = Curve([<curve referenced from the Rhino model> x17])
curve_6 = Curve([<curve referenced from the Rhino model> x11])
python_3_script_3 = Python3Script(lines=curve_5)  # -> out, a, b; inputs lines: list of Curve
# ---------- python_3_script_3: Python ----------
import rhinoscriptsyntax as rs
import Grasshopper as gh

def find_line_intersections(lines):
    # 初始化输出
    intersection_points = []  # 交点列表
    intersection_indices = gh.DataTree[object]()  # 交点对应的线段索引

    # 检查每对线段的相交情况
    for i in range(len(lines)):
        for j in range(i + 1, len(lines)):
            line1 = lines[i]
            line2 = lines[j]

            # 计算线段所在直线的相交
            intersections = rs.CurveCurveIntersection(line1, line2)

            if intersections:
                for intersection in intersections:
                    point = intersection[1]
                    # 获取两条曲线的起点和终点
                    start1, end1 = rs.CurveStartPoint(line1), rs.CurveEndPoint(line1)
                    start2, end2 = rs.CurveStartPoint(line2), rs.CurveEndPoint(line2)

                    # 判断交点是否在两条线段的范围内
                    in_line1 = is_point_on_line_segment(point, start1, end1)
                    in_line2 = is_point_on_line_segment(point, start2, end2)

                    if in_line1 and in_line2:
                        # 检查交点是否重复
                        is_duplicate = False
                        for existing_pt in intersection_points:
                            if rs.Distance(point, existing_pt) < 1e-6:
                                is_duplicate = True
                                break

                        if not is_duplicate:
                            intersection_points.append(point)
                            # 创建分支路径并添加对应的线段索引
                            path = gh.Kernel.Data.GH_Path(len(intersection_points) - 1)
                            intersection_indices.AddRange([i, j], path)

    return intersection_points, intersection_indices

def is_point_on_line_segment(point, start, end):
    """
    判断点是否在线段上
    """
    # 计算点到线段起点和终点的距离之和
    dist_to_start = rs.Distance(point, start)
    dist_to_end = rs.Distance(point, end)
    line_length = rs.Distance(start, end)

    # 如果距离之和近似等于线段长度，则点在线段上
    return abs((dist_to_start + dist_to_end) - line_length) < 1e-6

# Grasshopper输入变量为 "lines"，类型为 Curve
# 输出变量为 "points" 和 "indices"
points, indices = find_line_intersections(lines)

# 赋值给Grasshopper输出
a = points  # 交点列表
b = indices  # 交点对应的线段索引树
# ---------- end python_3_script_3 ----------
end_points_2 = EndPoints(Curve=curve_6)  # -> Start, End
point_4 = Point(python_3_script_3.a)
point_5 = Point([end_points_2.End, end_points_2.Start])
param_viewer = ParamViewer(python_3_script_3.b)
panel_6 = Panel(python_3_script_2.out)
panel_7 = Panel(removeduplicatepts)
removeduplicatepts_2 = RemoveDuplicatePts(Points=point_5, Tolerance=0.001)
python_3_script_4 = Python3Script(x=curve_6, y=point_4)  # -> out, dot_product; inputs x: list of Curve, y: list of Point3d; same code as python_3_script_2
list_item_3 = ListItem(List=curve_5, Index=python_3_script_3.b, Wrap=True)
panel_8 = Panel(removeduplicatepts_2)
panel_9 = Panel(list_item_3)
panel_10 = Panel(python_3_script_4.out)
set_difference_2 = SetDifference(SetA=python_3_script_4.out, SetB=removeduplicatepts_2)

# ---- group: 延伸定点
angle = Angle(VectorA=curve_4, VectorB=curve_3)  # -> Angle, Reflex
cosine = Cosine(Value=angle.Angle)
absolute = Absolute(Value=cosine)
curve_7 = Curve(<curve referenced from the Rhino model>)
point_6 = Point(<point referenced from the Rhino model>)
vector_2pt = Vector2Pt(PointA=point_6, PointB=point_3, Unitize=False)  # -> Vector, Length
length = Length(Curve=curve_7)
multiplication = Multiplication(A=absolute, B=Slider(0.667, range=0..1))
multiplication_2 = Multiplication(A=multiplication, B=length)
panel_11 = Panel(vector_2pt.Vector)
vector = Vector(vector_2pt.Vector)
unit_vector = UnitVector(Vector=vector)
panel_12 = Panel(multiplication_2)
multiplication_3 = Multiplication(A=unit_vector, B=multiplication_2)
move = Move(Geometry=point_3, Motion=multiplication_3)  # -> Geometry, Transform
panel_13 = Panel(multiplication_3)

# ----
point_7 = Point(set_difference_2)
panel_14 = Panel(point_7)
closest_point = ClosestPoint(Point=point_7, Cloud=point_4)  # -> ClosestPoint, CPIndex, Distance
tree_branch_2 = TreeBranch(Tree=list_item_3, Path=flatten(closest_point.CPIndex), MaintainPaths=True)
point_8 = Point(closest_point.ClosestPoint)
curve_8 = Curve([<curve referenced from the Rhino model> x6])
point_9 = Point([<point referenced from the Rhino model> x3])
panel_15 = Panel(tree_branch_2)
list_item_4 = ListItem(List=tree_branch_2, Index=0, Wrap=True)  # -> flatten(Item), flatten(Item1)
python_3_script_5 = Python3Script(center_points=point_9, curves=curve_8, nearby_points=point_8)  # -> flatten(a); inputs center_points: list of Point3d, curves: list of Curve, nearby_points: list of Point3d
# ---------- python_3_script_5: Python ----------
import rhinoscriptsyntax as rs
import Grasshopper as gh


def find_points_on_intersecting_curves(center_points, curves, nearby_points):
    # 检查输入是否为 None
    if center_points is None or curves is None or nearby_points is None:
        return gh.DataTree[object]()

    result_tree = gh.DataTree[object]()

    for i, center_point in enumerate(center_points):
        intersecting_curves = []
        # 找到与中心点相交的曲线
        for curve in curves:
            # 计算点到曲线的最近点
            param = rs.CurveClosestPoint(curve, center_point)
            closest_point = rs.EvaluateCurve(curve, param)
            # 判断点是否在曲线上
            if rs.Distance(center_point, closest_point) < 1e-6:
                intersecting_curves.append(curve)
                if len(intersecting_curves) == 2:
                    break

        # 存储在相交曲线上的附近点
        points_on_curves = []
        for curve in intersecting_curves:
            for nearby_point in nearby_points:
                # 计算点到曲线的最近点
                param = rs.CurveClosestPoint(curve, nearby_point)
                closest_point = rs.EvaluateCurve(curve, param)
                # 判断点是否在曲线上
                if rs.Distance(nearby_point, closest_point) < 1e-6:
                    points_on_curves.append(nearby_point)

        # 将结果添加到树中
        path = gh.Kernel.Data.GH_Path(i)
        result_tree.AddRange(points_on_curves, path)

    return result_tree


# Grasshopper 输入变量
# center_points 是路网中心点集
# curves 是路网曲线集
# nearby_points 是中心点附近的点集
# 输出变量为 result
result = find_points_on_intersecting_curves(center_points, curves, nearby_points)

# 赋值给 Grasshopper 输出
a = result
# ---------- end python_3_script_5 ----------
curve_9 = Curve(list_item_4.Item)
curve_10 = Curve(list_item_4.Item1)
angle_2 = Angle(VectorA=curve_9, VectorB=curve_10)  # -> Angle, Reflex
curve_11 = Curve([<curve referenced from the Rhino model> x11])
panel_16 = Panel(curve_10)

number_slider = Slider(9, range=0..11)
list_item_5 = ListItem(List=curve_10, Index=number_slider, Wrap=True)
list_item_6 = ListItem(List=curve_9, Index=number_slider, Wrap=True)
list_item_7 = ListItem(List=python_3_script_5, Index=number_slider, Wrap=True)

python_3_script_6 = Python3Script(points=point_8, curves=curve_11)  # -> a; inputs points: list of Point3d, curves: list of Curve
# ---------- python_3_script_6: Python ----------
import rhinoscriptsyntax as rs
import Grasshopper as gh

def find_segment_for_each_point(points, curves):
    result_segments = []

    for point in points:
        found_segment = None
        for curve in curves:
            # 计算点到曲线的最近点
            param = rs.CurveClosestPoint(curve, point)
            closest_point = rs.EvaluateCurve(curve, param)
            # 判断点是否在曲线上
            if rs.Distance(point, closest_point) < 1e-6:
                found_segment = curve
                break

        result_segments.append(found_segment)

    return result_segments

# Grasshopper 输入变量
# points 是点集
# curves 是曲线集
# 输出变量为 result_segments
result_segments = find_segment_for_each_point(points, curves)

# 赋值给 Grasshopper 输出
a = result_segments
# ---------- end python_3_script_6 ----------
cosine_2 = Cosine(Value=angle_2.Angle)
vector_2pt_2 = Vector2Pt(PointA=point_9, PointB=python_3_script_5, Unitize=False)  # -> Vector, Length
panel_17 = Panel(python_3_script_6)
absolute_2 = Absolute(Value=cosine_2)
length_2 = Length(Curve=python_3_script_6)
vector_2 = Vector(vector_2pt_2.Vector)
multiplication_4 = Multiplication(A=absolute_2, B=Slider(0.667, range=0..1))
multiplication_5 = Multiplication(A=multiplication_4, B=length_2)
unit_vector_2 = UnitVector(Vector=vector_2)  # -> flatten(Vector)
panel_18 = Panel(multiplication_5)
multiplication_6 = Multiplication(A=unit_vector_2, B=multiplication_5)
panel_19 = Panel(unit_vector_2)
panel_20 = Panel(multiplication_6)
move_2 = Move(Geometry=point_8, Motion=flatten(multiplication_6))  # -> Geometry, Transform
