# Grasshopper definition capture point offset_try2.gh (Grasshopper 1.0.8)
# plug-ins: RhinoCodePluginGH, Kangaroo Components

# ----
# 上下两条流是一样的
# 输入端
# 道路中心点
# 斑马线
# 道路中心线
point = Point([<point referenced from the Rhino model> x3])
curve = Curve([<curve referenced from the Rhino model> x11])
curve_2 = Curve([<curve referenced from the Rhino model> x6])

# ----
# 输入端
# 道路中心点
# 斑马线
# 道路中心线
point_2 = Point([<point referenced from the Rhino model> x3])
curve_3 = Curve([<curve referenced from the Rhino model> x11])
curve_4 = Curve([<curve referenced from the Rhino model> x6])

# ----
# 输入端
# 道路中心点
point_3 = Point([<point referenced from the Rhino model> x9])

curve_5 = Curve([curve, curve_2])

# ----
# 斑马线
curve_6 = Curve([<curve referenced from the Rhino model> x35])

# ----
# 断开道路中心线
curve_7 = Curve([<curve referenced from the Rhino model> x82])

# ----
# 路网与斑马线交点
point_4 = Point([<point referenced from the Rhino model> x39])

# ----
# 输入端
# 道路中心点
point_5 = Point([<point referenced from the Rhino model> x2])

# ----
# 连续道路中心线
curve_8 = Curve([<curve referenced from the Rhino model> x9])

# ----
# 斑马线
curve_9 = Curve([<curve referenced from the Rhino model> x10])

# ----
# 断开道路中心线
curve_10 = Curve([<curve referenced from the Rhino model> x33])

# ----
# 路网与斑马线交点
point_6 = Point([<point referenced from the Rhino model> x10])

python_3_script = Python3Script(lines=curve_5)  # -> out, a, b; inputs lines: list of Curve
# ---------- python_3_script: Python ----------
import rhinoscriptsyntax as rs
import Grasshopper as gh

def find_line_intersections(lines):
    # 初始化输出
    intersection_points = []  # 交点列表
    intersection_indices = gh.DataTree[object]()  # 交点对应的线段索引

    # 检查每对线段的相交情况
    for i in range(len(lines)):
        for j in range(i + 1, len(lines)):
            line1 = lines[i]
            line2 = lines[j]

            # 计算线段所在直线的相交
            intersections = rs.CurveCurveIntersection(line1, line2)

            if intersections:
                for intersection in intersections:
                    point = intersection[1]
                    # 获取两条曲线的起点和终点
                    start1, end1 = rs.CurveStartPoint(line1), rs.CurveEndPoint(line1)
                    start2, end2 = rs.CurveStartPoint(line2), rs.CurveEndPoint(line2)

                    # 判断交点是否在两条线段的范围内
                    in_line1 = is_point_on_line_segment(point, start1, end1)
                    in_line2 = is_point_on_line_segment(point, start2, end2)

                    if in_line1 and in_line2:
                        # 检查交点是否重复
                        is_duplicate = False
                        for existing_pt in intersection_points:
                            if rs.Distance(point, existing_pt) < 1e-6:
                                is_duplicate = True
                                break

                        if not is_duplicate:
                            intersection_points.append(point)
                            # 创建分支路径并添加对应的线段索引
                            path = gh.Kernel.Data.GH_Path(len(intersection_points) - 1)
                            intersection_indices.AddRange([i, j], path)

    return intersection_points, intersection_indices

def is_point_on_line_segment(point, start, end):
    """
    判断点是否在线段上
    """
    # 计算点到线段起点和终点的距离之和
    dist_to_start = rs.Distance(point, start)
    dist_to_end = rs.Distance(point, end)
    line_length = rs.Distance(start, end)

    # 如果距离之和近似等于线段长度，则点在线段上
    return abs((dist_to_start + dist_to_end) - line_length) < 1e-6

# Grasshopper输入变量为 "lines"，类型为 Curve
# 输出变量为 "points" 和 "indices"
points, indices = find_line_intersections(lines)

# 赋值给Grasshopper输出
a = points  # 交点列表
b = indices  # 交点对应的线段索引树
# ---------- end python_3_script ----------
# 取斑马线上的交点，并生成这些点由哪两条线相交
curve_11 = Curve([curve_3, curve_4])
end_points = EndPoints(Curve=curve)  # -> Start, End

python_3_script_2 = Python3Script(lines=curve_11)  # -> out, a, b; inputs lines: list of Curve; same code as python_3_script
python_3_script_3 = Python3Script(x=curve_3, y=python_3_script_2.a)  # -> out, dot_product; inputs x: list of Curve, y: list of Point3d
# ---------- python_3_script_3: Python ----------
import Rhino.Geometry as rg
import math

# 输入参数
lines = x  # 线段列表
points = y  # 点列表
tolerance = 0.001

# 确保 points 是列表格式
if isinstance(points, rg.Point3d):
    points = [points]

result_points = []

for p in points:
    for line in lines:
        a = line.PointAtStart  # 线段起点
        b = line.PointAtEnd    # 线段终点
        
        # 计算向量AP和AB
        ap = p - a
        ab = b - a
        
        # 计算点积
        dot_product = ap * ab
        
        # 计算向量的模长
        ap_length = ap.Length
        ab_length = ab.Length
        
        # 计算理论上的最大点积
        max_dot_product = ap_length * ab_length
        
        # 判断点积是否接近于最大点积
        if abs(dot_product - max_dot_product) <= tolerance * max_dot_product and ab_length > tolerance:
            # 判断点是否在线段AB之间（点积在0到AB²之间）
            dot_ab_sq = ab * ab
            if 0 <= dot_product <= dot_ab_sq:
                result_points.append(p)  # 存储找到的点
                break  # 找到后跳出线段循环，避免重复添加

# 输出结果
out = result_points
# ---------- end python_3_script_3 ----------

point_7 = Point(python_3_script.a)
python_3_script_4 = Python3Script(intersection_points=point_4, centerlines=curve_7, crosswalks=curve_6)  # -> a; inputs intersection_points: list of Point3d, centerlines: list of Curve, crosswalks: list of Curve
# ---------- python_3_script_4: Python ----------
import rhinoscriptsyntax as rs
import Grasshopper as gh


def find_matching_curves(intersection_points, centerlines, crosswalks):
    result_tree = gh.DataTree[object]()

    for i, point in enumerate(intersection_points):
        centerline_match = None
        crosswalk_match = None

        # 查找与点相交的中心线
        for centerline in centerlines:
            param = rs.CurveClosestPoint(centerline, point)
            closest_point = rs.EvaluateCurve(centerline, param)
            if rs.Distance(point, closest_point) < 1e-6:
                centerline_match = centerline
                break

        # 查找与点相交的斑马线
        for crosswalk in crosswalks:
            param = rs.CurveClosestPoint(crosswalk, point)
            closest_point = rs.EvaluateCurve(crosswalk, param)
            if rs.Distance(point, closest_point) < 1e-6:
                crosswalk_match = crosswalk
                break

        # 若都找到匹配的曲线，则添加到结果树
        if centerline_match and crosswalk_match:
            path = gh.Kernel.Data.GH_Path(i)
            result_tree.Add(point, path)
            result_tree.Add(centerline_match, path)
            result_tree.Add(crosswalk_match, path)

    return result_tree


# Grasshopper 输入变量
# intersection_points 是路网中心线与斑马线交汇的点集
# centerlines 是路网中心线集
# crosswalks 是斑马线集
# 输出变量为 result
result = find_matching_curves(intersection_points, centerlines, crosswalks)

# 赋值给 Grasshopper 输出
a = result
# ---------- end python_3_script_4 ----------
python_3_script_5 = Python3Script(intersection_points=point_6, centerlines=curve_10, crosswalks=curve_9)  # -> a; inputs intersection_points: list of Point3d, centerlines: list of Curve, crosswalks: list of Curve; same code as python_3_script_4
point_8 = Point([end_points.End, end_points.Start])
python_3_script_6 = Python3Script(x=curve, y=point_7)  # -> out, dot_product; inputs x: list of Curve, y: list of Point3d; same code as python_3_script_3
removeduplicatepts = RemoveDuplicatePts(Points=point_8, Tolerance=0.001)
panel = Panel(python_3_script_6.out)
# 去除斑马线端点
cluster = Cluster(set_a=python_3_script_3.out, curve=curve_3)
list_item = ListItem(List=curve_5, Index=python_3_script.b, Wrap=True)
panel_2 = Panel(removeduplicatepts)
list_item_2 = ListItem(List=python_3_script_4, Index=0, Wrap=True)
set_difference = SetDifference(SetA=python_3_script_6.out, SetB=removeduplicatepts)
list_item_3 = ListItem(List=python_3_script_5, Index=0, Wrap=True)
panel_3 = Panel(list_item)
# 斑马线上的点
point_9 = Point(cluster)

# ----
# 斑马线上点对应的两条线
list_item_4 = ListItem(List=curve_11, Index=python_3_script_2.b, Wrap=True)
closest_point = ClosestPoint(Point=point_9, Cloud=python_3_script_2.a)  # -> ClosestPoint, CPIndex, Distance
# （数据结构转换）
# 与道路中心点配对
tree_branch = TreeBranch(Tree=list_item_4, Path=flatten(closest_point.CPIndex), MaintainPaths=True)
list_item_5 = ListItem(List=tree_branch, Index=0, Wrap=True)  # -> flatten(Item), flatten(Item1)
curve_12 = Curve(list_item_5.Item1)
curve_13 = Curve(list_item_5.Item)

point_10 = Point(list_item_2)
point_11 = Point(list_item_3)
python_3_script_7 = Python3Script(a=python_3_script_4)  # -> junction, center, cross; inputs a: tree
# ---------- python_3_script_7: Python ----------
import Grasshopper as gh

# 假设输入参数为 a，即上一个 Python 电池的输出
points = gh.DataTree[object]()
centerlines = gh.DataTree[object]()
crosswalks = gh.DataTree[object]()

# 遍历输入的树状数据
for i in range(a.BranchCount):
    branch = a.Branch(i)
    if len(branch) == 3:
        point = branch[0]
        centerline = branch[1]
        crosswalk = branch[2]

        path = gh.Kernel.Data.GH_Path(i)
        points.Add(point, path)
        centerlines.Add(centerline, path)
        crosswalks.Add(crosswalk, path)

# 赋值给 Grasshopper 输出
junction = points
center = centerlines
cross = crosswalks
# ---------- end python_3_script_7 ----------
point_12 = Point(set_difference)
python_3_script_8 = Python3Script(a=python_3_script_5)  # -> junction, center, cross; inputs a: tree; same code as python_3_script_7
# （数据结构转换）
# 与道路中心点配对
python_3_script_9 = Python3Script(center_points=point_5, curves=curve_8, nearby_points=point_11)  # -> a; inputs center_points: list of Point3d, curves: list of Curve, nearby_points: list of Point3d
# ---------- python_3_script_9: Python ----------
import rhinoscriptsyntax as rs
import Grasshopper as gh


def find_points_on_intersecting_curves(center_points, curves, nearby_points):
    # 检查输入是否为 None
    if center_points is None or curves is None or nearby_points is None:
        return gh.DataTree[object]()

    result_tree = gh.DataTree[object]()
    tolerance = rs.UnitAbsoluteTolerance()  # 使用 Rhino 的绝对公差

    for i, center_point in enumerate(center_points):
        intersecting_curves = []
        # 找到与中心点相交的所有曲线
        for curve in curves:
            # 计算点到曲线的最近点
            param = rs.CurveClosestPoint(curve, center_point)
            closest_point = rs.EvaluateCurve(curve, param)
            # 判断点是否在曲线上，使用 Rhino 的绝对公差
            if rs.Distance(center_point, closest_point) < tolerance:
                intersecting_curves.append(curve)

        # 存储在相交曲线上的附近点
        points_on_curves = []
        for curve in intersecting_curves:
            for nearby_point in nearby_points:
                # 计算点到曲线的最近点
                param = rs.CurveClosestPoint(curve, nearby_point)
                closest_point = rs.EvaluateCurve(curve, param)
                # 判断点是否在曲线上，使用 Rhino 的绝对公差
                if rs.Distance(nearby_point, closest_point) < tolerance:
                    points_on_curves.append(nearby_point)

        # 将结果添加到树中
        path = gh.Kernel.Data.GH_Path(i)
        result_tree.AddRange(points_on_curves, path)

    return result_tree


# Grasshopper 输入变量
# center_points 是路网中心点集
# curves 是路网曲线集
# nearby_points 是中心点附近的点集
# 输出变量为 result
result = find_points_on_intersecting_curves(center_points, curves, nearby_points)

# 赋值给 Grasshopper 输出
a = result
# ---------- end python_3_script_9 ----------
panel_4 = Panel(point_12)
# （数据结构转换）
# 与道路中心点配对
python_3_script_10 = Python3Script(center=graft(point_3), corner=flatten(point_10), radius=Slider(75, range=0..100))  # -> simplify(nearby); inputs center: list of Point3d, corner: list of Point3d, radius: Int32
# ---------- python_3_script_10: Python ----------
import Rhino.Geometry as rg
import math


# 初始化结果列表（每个元素对应点集A中一个点的邻近点列表）
result = []

for pt_a in center:
    nearby = []  # 当前圆心点pt_a的邻近点列表
    for pt_b in corner:
        # 计算两点之间的欧氏距离
        dx = pt_a.X - pt_b.X
        dy = pt_a.Y - pt_b.Y
        dz = pt_a.Z - pt_b.Z
        distance = math.sqrt(dx**2 + dy**2 + dz**2)
        
        if distance <= radius:
            nearby.append(pt_b)
    
    result.append(nearby)

# 输出结果：每个点对应的邻近点列表
out = result
# ---------- end python_3_script_10 ----------
panel_5 = Panel(python_3_script_5)

curve_14 = Curve(python_3_script_7.cross)
curve_15 = Curve(python_3_script_7.center)

point_13 = Point(flatten(python_3_script_10))

curve_16 = Curve(python_3_script_8.cross)
curve_17 = Curve(python_3_script_8.center)

point_14 = Point(flatten(python_3_script_9))
closest_point_2 = ClosestPoint(Point=point_12, Cloud=point_7)  # -> ClosestPoint, CPIndex, Distance
python_3_script_11 = Python3Script(center_points=point_2, curves=curve_4, nearby_points=closest_point.ClosestPoint)  # -> a; inputs center_points: list of Point3d, curves: list of Curve, nearby_points: list of Point3d
# ---------- python_3_script_11: Python ----------
import rhinoscriptsyntax as rs
import Grasshopper as gh


def find_points_on_intersecting_curves(center_points, curves, nearby_points):
    # 检查输入是否为 None
    if center_points is None or curves is None or nearby_points is None:
        return gh.DataTree[object]()

    result_tree = gh.DataTree[object]()

    for i, center_point in enumerate(center_points):
        intersecting_curves = []
        # 找到与中心点相交的曲线
        for curve in curves:
            # 计算点到曲线的最近点
            param = rs.CurveClosestPoint(curve, center_point)
            closest_point = rs.EvaluateCurve(curve, param)
            # 判断点是否在曲线上
            if rs.Distance(center_point, closest_point) < 1e-6:
                intersecting_curves.append(curve)
                if len(intersecting_curves) == 2:
                    break

        # 存储在相交曲线上的附近点
        points_on_curves = []
        for curve in intersecting_curves:
            for nearby_point in nearby_points:
                # 计算点到曲线的最近点
                param = rs.CurveClosestPoint(curve, nearby_point)
                closest_point = rs.EvaluateCurve(curve, param)
                # 判断点是否在曲线上
                if rs.Distance(nearby_point, closest_point) < 1e-6:
                    points_on_curves.append(nearby_point)

        # 将结果添加到树中
        path = gh.Kernel.Data.GH_Path(i)
        result_tree.AddRange(points_on_curves, path)

    return result_tree


# Grasshopper 输入变量
# center_points 是路网中心点集
# curves 是路网曲线集
# nearby_points 是中心点附近的点集
# 输出变量为 result
result = find_points_on_intersecting_curves(center_points, curves, nearby_points)

# 赋值给 Grasshopper 输出
a = result
# ---------- end python_3_script_11 ----------

# ----
# 中心点-斑马线上点-斑马线上点对应的两条线
# 四者顺序对应
member_index = MemberIndex(Set=flatten(point_10), Member=point_13)  # -> simplify(Index), Count
list_item_6 = ListItem(List=flatten(curve_15), Index=flatten(member_index.Index), Wrap=True)
list_item_7 = ListItem(List=flatten(curve_14), Index=flatten(member_index.Index), Wrap=True)

# ----
# 中心点-斑马线上点-斑马线上点对应的两条线
# 四者顺序对应
member_index_2 = MemberIndex(Set=flatten(point_11), Member=point_14)  # -> simplify(Index), Count
list_item_8 = ListItem(List=flatten(curve_17), Index=flatten(member_index_2.Index), Wrap=True)
list_item_9 = ListItem(List=flatten(curve_16), Index=flatten(member_index_2.Index), Wrap=True)

tree_branch_2 = TreeBranch(Tree=list_item, Path=flatten(closest_point_2.CPIndex), MaintainPaths=True)
point_15 = Point(flatten(python_3_script_11))
panel_6 = Panel(tree_branch_2)
list_item_10 = ListItem(List=tree_branch_2, Index=0, Wrap=True)  # -> flatten(Item), flatten(Item1)
point_16 = Point(closest_point_2.ClosestPoint)
python_3_script_12 = Python3Script(center_points=point, curves=curve_2, nearby_points=point_16)  # -> a; inputs center_points: list of Point3d, curves: list of Curve, nearby_points: list of Point3d; same code as python_3_script_11

# ----
# 中心点-斑马线上点-斑马线上点对应的两条线
# 四者顺序对应
member_index_3 = MemberIndex(Set=closest_point.ClosestPoint, Member=point_15)  # -> simplify(Index), Count
list_item_11 = ListItem(List=curve_13, Index=member_index_3.Index, Wrap=True)  # -> flatten(Item)
list_item_12 = ListItem(List=curve_12, Index=member_index_3.Index, Wrap=True)  # -> flatten(Item)

curve_18 = Curve(list_item_10.Item1)
curve_19 = Curve(list_item_10.Item)
point_17 = Point(flatten(python_3_script_12))

# ----
# 向量计算
# 斑马线上的点在哪条斑马线
point_18 = Point(simplify(graft(point_3)))
angle = Angle(VectorA=list_item_7, VectorB=list_item_6)  # -> Angle, Reflex
vector_2pt = Vector2Pt(PointA=point_18, PointB=python_3_script_10, Unitize=False)  # -> Vector, Length
python_3_script_13 = Python3Script(points=point_13, curves=curve_6)  # -> a; inputs points: list of Point3d, curves: list of Curve
# ---------- python_3_script_13: Python ----------
import rhinoscriptsyntax as rs
import Grasshopper as gh

def find_segment_for_each_point(points, curves):
    result_segments = []

    for point in points:
        found_segment = None
        for curve in curves:
            # 计算点到曲线的最近点
            param = rs.CurveClosestPoint(curve, point)
            closest_point = rs.EvaluateCurve(curve, param)
            # 判断点是否在曲线上
            if rs.Distance(point, closest_point) < 1e-6:
                found_segment = curve
                break

        result_segments.append(found_segment)

    return result_segments

# Grasshopper 输入变量
# points 是点集
# curves 是曲线集
# 输出变量为 result_segments
result_segments = find_segment_for_each_point(points, curves)

# 赋值给 Grasshopper 输出
a = result_segments
# ---------- end python_3_script_13 ----------
cosine = Cosine(Value=angle.Angle)
absolute = Absolute(Value=cosine)
length = Length(Curve=python_3_script_13)
unit_vector = UnitVector(Vector=vector_2pt.Vector)  # -> flatten(Vector)
multiplication = Multiplication(A=absolute, B=Slider(0.667, range=0..1))
multiplication_2 = Multiplication(A=multiplication, B=length)
multiplication_3 = Multiplication(A=unit_vector, B=multiplication_2)

panel_7 = Panel(python_3_script_12)
member_index_4 = MemberIndex(Set=point_16, Member=point_17)  # -> simplify(Index), Count

# ----
# 向量计算
# 斑马线上的点在哪条斑马线
point_19 = Point(simplify(graft(point_5)))
angle_2 = Angle(VectorA=list_item_9, VectorB=list_item_8)  # -> Angle, Reflex
vector_2pt_2 = Vector2Pt(PointA=point_19, PointB=python_3_script_9, Unitize=False)  # -> Vector, Length
python_3_script_14 = Python3Script(points=point_14, curves=curve_9)  # -> a; inputs points: list of Point3d, curves: list of Curve; same code as python_3_script_13
cosine_2 = Cosine(Value=angle_2.Angle)
absolute_2 = Absolute(Value=cosine_2)
length_2 = Length(Curve=python_3_script_14)
unit_vector_2 = UnitVector(Vector=vector_2pt_2.Vector)  # -> flatten(Vector)
multiplication_4 = Multiplication(A=absolute_2, B=Slider(0.667, range=0..1))
multiplication_5 = Multiplication(A=multiplication_4, B=length_2)
multiplication_6 = Multiplication(A=unit_vector_2, B=multiplication_5)

list_item_13 = ListItem(List=curve_19, Index=member_index_4.Index, Wrap=True)  # -> flatten(Item)
list_item_14 = ListItem(List=curve_18, Index=member_index_4.Index, Wrap=True)  # -> flatten(Item)
panel_8 = Panel(member_index_4.Index)

# ----
# 斑马线上的点在哪条斑马线
angle_3 = Angle(VectorA=list_item_11, VectorB=list_item_12)  # -> Angle, Reflex
# 向量计算
point_20 = Point(graft(point_2))
vector_2pt_3 = Vector2Pt(PointA=point_20, PointB=python_3_script_11, Unitize=False)  # -> Vector, Length
python_3_script_15 = Python3Script(points=point_15, curves=curve_3)  # -> a; inputs points: list of Point3d, curves: list of Curve; same code as python_3_script_13
cosine_3 = Cosine(Value=angle_3.Angle)
absolute_3 = Absolute(Value=cosine_3)
length_3 = Length(Curve=python_3_script_15)
unit_vector_3 = UnitVector(Vector=vector_2pt_3.Vector)  # -> flatten(Vector)
multiplication_7 = Multiplication(A=absolute_3, B=Slider(0.667, range=0..1))
multiplication_8 = Multiplication(A=multiplication_7, B=length_3)
multiplication_9 = Multiplication(A=unit_vector_3, B=multiplication_8)

angle_4 = Angle(VectorA=list_item_13, VectorB=list_item_14)  # -> Angle, Reflex
point_21 = Point(graft(point))
curve_20 = Curve([<curve referenced from the Rhino model> x11])
vector_2pt_4 = Vector2Pt(PointA=point_21, PointB=python_3_script_12, Unitize=False)  # -> Vector, Length
python_3_script_16 = Python3Script(points=point_17, curves=curve_20)  # -> a; inputs points: list of Point3d, curves: list of Curve; same code as python_3_script_13
cosine_4 = Cosine(Value=angle_4.Angle)
move = Move(Geometry=point_13, Motion=flatten(multiplication_3))  # -> Geometry, Transform
move_2 = Move(Geometry=point_14, Motion=flatten(multiplication_6))  # -> Geometry, Transform
panel_9 = Panel(python_3_script_16)
absolute_4 = Absolute(Value=cosine_4)
length_4 = Length(Curve=python_3_script_16)
# 输出端
point_22 = Point(move.Geometry)
move_3 = Move(Geometry=point_15, Motion=flatten(multiplication_9))  # -> Geometry, Transform
multiplication_10 = Multiplication(A=absolute_4, B=Slider(0.667, range=0..1))
vector = Vector(vector_2pt_4.Vector)
# 输出端
point_23 = Point(move_2.Geometry)
unit_vector_4 = UnitVector(Vector=vector)  # -> flatten(Vector)
multiplication_11 = Multiplication(A=multiplication_10, B=length_4)
panel_10 = Panel(multiplication_11)
# 输出端
point_24 = Point(move_3.Geometry)
multiplication_12 = Multiplication(A=unit_vector_4, B=multiplication_11)
panel_11 = Panel(unit_vector_4)
panel_12 = Panel(multiplication_12)
# 输出端
move_4 = Move(Geometry=point_17, Motion=flatten(multiplication_12))  # -> Geometry, Transform
panel_13 = Panel(move_4.Geometry)
# 斑马线
curve_21 = Curve([<curve referenced from the Rhino model> x35])
# 断开道路中心线
curve_22 = Curve([<curve referenced from the Rhino model> x82])
# 道路中心点
point_25 = Point([<point referenced from the Rhino model> x9])
# 连续道路中心线
curve_23 = Curve([<curve referenced from the Rhino model> x80])
# 取斑马线上的交点，并生成这些点由哪两条线相交
curve_24 = Curve([curve_21, curve_22])  # disabled

python_3_script_17 = Python3Script(lines=curve_24)  # -> out, a, b; inputs lines: list of Curve; disabled; same code as python_3_script
python_3_script_18 = Python3Script(x=curve_21, y=python_3_script_17.a)  # -> out, dot_product; inputs x: list of Curve, y: list of Point3d; disabled; same code as python_3_script_3

# ----
# 去除斑马线端点
cluster_2 = Cluster(set_a=python_3_script_18.out, curve=curve_21)  # disabled
# 斑马线上的点
point_26 = Point(cluster_2)  # disabled

# ----
# 斑马线上点对应的两条线
list_item_15 = ListItem(List=curve_24, Index=python_3_script_17.b, Wrap=True)  # disabled
closest_point_3 = ClosestPoint(Point=point_26, Cloud=python_3_script_17.a)  # -> ClosestPoint, CPIndex, Distance; disabled
tree_branch_3 = TreeBranch(Tree=list_item_15, Path=flatten(closest_point_3.CPIndex), MaintainPaths=True)  # disabled
list_item_16 = ListItem(List=tree_branch_3, Index=0, Wrap=True)  # -> flatten(Item), flatten(Item1); disabled
curve_25 = Curve(list_item_16.Item1)  # disabled
curve_26 = Curve(list_item_16.Item)  # disabled

# ----
# （数据结构转换）
# 与道路中心点配对
python_3_script_19 = Python3Script(center_points=point_25, curves=curve_23, nearby_points=closest_point_3.ClosestPoint)  # -> a; inputs center_points: list of Point3d, curves: list of Curve, nearby_points: list of Point3d; disabled; same code as python_3_script_11
point_27 = Point(flatten(python_3_script_19))  # disabled

# ----
# 中心点-斑马线上点-斑马线上点对应的两条线
# 四者顺序对应
member_index_5 = MemberIndex(Set=closest_point_3.ClosestPoint, Member=point_27)  # -> simplify(Index), Count; disabled
list_item_17 = ListItem(List=curve_26, Index=member_index_5.Index, Wrap=True)  # -> flatten(Item); disabled
list_item_18 = ListItem(List=curve_25, Index=member_index_5.Index, Wrap=True)  # -> flatten(Item); disabled

# ----
# 斑马线上的点在哪条斑马线
angle_5 = Angle(VectorA=list_item_17, VectorB=list_item_18)  # -> Angle, Reflex; disabled
# 向量计算
point_28 = Point(graft(point_25))  # disabled
vector_2pt_5 = Vector2Pt(PointA=point_28, PointB=python_3_script_19, Unitize=False)  # -> Vector, Length; disabled
python_3_script_20 = Python3Script(points=point_27, curves=curve_21)  # -> a; inputs points: list of Point3d, curves: list of Curve; disabled; same code as python_3_script_13
cosine_5 = Cosine(Value=angle_5.Angle)  # disabled
number_slider = Slider(0.667, range=0..1)  # disabled
absolute_5 = Absolute(Value=cosine_5)  # disabled
length_5 = Length(Curve=python_3_script_20)  # disabled
unit_vector_5 = UnitVector(Vector=vector_2pt_5.Vector)  # -> flatten(Vector); disabled
multiplication_13 = Multiplication(A=absolute_5, B=number_slider)  # disabled
multiplication_14 = Multiplication(A=multiplication_13, B=length_5)  # disabled
multiplication_15 = Multiplication(A=unit_vector_5, B=multiplication_14)  # disabled

move_5 = Move(Geometry=point_27, Motion=flatten(multiplication_15))  # -> Geometry, Transform; disabled
# 输出端
point_29 = Point(move_5.Geometry)  # disabled

# ----
# 输入端
# 输入端
# 道路中心点
# 输出端
point_30 = Point([<point referenced from the Rhino model> x113])
# 连续道路中心线
curve_27 = Curve([<curve referenced from the Rhino model> x528])
# 斑马线
curve_28 = Curve([<curve referenced from the Rhino model> x316])
# 断开道路中心线
curve_29 = Curve([<curve referenced from the Rhino model> x1208])
# 路网与斑马线交点
point_31 = Point([<point referenced from the Rhino model> x361])
python_3_script_21 = Python3Script(intersection_points=point_31, centerlines=curve_29, crosswalks=curve_28)  # -> a; inputs intersection_points: list of Point3d, centerlines: list of Curve, crosswalks: list of Curve; disabled; same code as python_3_script_4
list_item_19 = ListItem(List=python_3_script_21, Index=0, Wrap=True)  # disabled
point_32 = Point(list_item_19)  # disabled
python_3_script_22 = Python3Script(a=python_3_script_21)  # -> junction, center, cross; inputs a: tree; disabled; same code as python_3_script_7
# （数据结构转换）
# 与道路中心点配对
python_3_script_23 = Python3Script(center_points=point_30, curves=curve_27, nearby_points=point_32)  # -> a; inputs center_points: list of Point3d, curves: list of Curve, nearby_points: list of Point3d; disabled
# ---------- python_3_script_23: Python ----------
import rhinoscriptsyntax as rs
import Grasshopper as gh
from concurrent.futures import ThreadPoolExecutor


def find_points_on_intersecting_curves(center_points, curves, nearby_points):
    # 检查输入是否为 None
    if center_points is None or curves is None or nearby_points is None:
        return gh.DataTree[object]()

    result_tree = gh.DataTree[object]()
    tolerance = rs.UnitAbsoluteTolerance()  # 使用 Rhino 的绝对公差
    search_range = 300  # 设置搜索范围为 300 米

    # 缓存曲线的中点
    curve_midpoints = {curve: rs.CurveMidPoint(curve) for curve in curves}

    def process_center_point(center_point, index):
        intersecting_curves = []
        # 找到中心点周边一定范围内的曲线
        nearby_curves = []
        for curve in curves:
            curve_bbox = rs.BoundingBox(curve)
            if curve_bbox:
                # 检查曲线的边界框是否在中心点的搜索范围内
                min_point = curve_bbox[0]
                max_point = curve_bbox[6]
                if (
                    rs.Distance(center_point, min_point) <= search_range
                    or rs.Distance(center_point, max_point) <= search_range
                ):
                    nearby_curves.append(curve)

        # 找到与中心点相交的所有曲线
        for curve in nearby_curves:
            # 计算点到曲线的最近点
            param = rs.CurveClosestPoint(curve, center_point)
            if param is not None:
                closest_point = rs.EvaluateCurve(curve, param)
                # 判断点是否在曲线上，使用 Rhino 的绝对公差
                if rs.Distance(center_point, closest_point) < tolerance:
                    intersecting_curves.append(curve)

        # 存储在相交曲线上的附近点
        points_on_curves = []
        for curve in intersecting_curves:
            # 过滤出在搜索范围内的附近点
            midpoint = curve_midpoints[curve]
            filtered_nearby_points = [
                pt for pt in nearby_points if rs.Distance(pt, midpoint) <= search_range
            ]
            for nearby_point in filtered_nearby_points:
                # 计算点到曲线的最近点
                param = rs.CurveClosestPoint(curve, nearby_point)
                if param is not None:
                    closest_point = rs.EvaluateCurve(curve, param)
                    # 判断点是否在曲线上，使用 Rhino 的绝对公差
                    if rs.Distance(nearby_point, closest_point) < tolerance:
                        points_on_curves.append(nearby_point)

        # 将结果添加到树中
        path = gh.Kernel.Data.GH_Path(index)
        result_tree.AddRange(points_on_curves, path)

    # 使用线程池进行并行计算
    with ThreadPoolExecutor() as executor:
        futures = [executor.submit(process_center_point, pt, i) for i, pt in enumerate(center_points)]
        for future in futures:
            future.result()

    return result_tree


# Grasshopper 输入变量
# center_points 是路网中心点集
# curves 是路网曲线集
# nearby_points 是中心点附近的点集
# 输出变量为 result
result = find_points_on_intersecting_curves(center_points, curves, nearby_points)

# 赋值给 Grasshopper 输出
a = result
# ---------- end python_3_script_23 ----------
point_33 = Point(flatten(python_3_script_23))  # disabled

curve_30 = Curve(python_3_script_22.cross)  # disabled
curve_31 = Curve(python_3_script_22.center)  # disabled

# ----
# 中心点-斑马线上点-斑马线上点对应的两条线
# 四者顺序对应
member_index_6 = MemberIndex(Set=flatten(point_32), Member=point_33)  # -> simplify(Index), Count; disabled
list_item_20 = ListItem(List=flatten(curve_31), Index=flatten(member_index_6.Index), Wrap=True)  # disabled
list_item_21 = ListItem(List=flatten(curve_30), Index=flatten(member_index_6.Index), Wrap=True)  # disabled

# ----
# 向量计算
point_34 = Point(simplify(graft(point_30)))  # disabled
angle_6 = Angle(VectorA=list_item_21, VectorB=list_item_20)  # -> Angle, Reflex; disabled
vector_2pt_6 = Vector2Pt(PointA=point_34, PointB=python_3_script_23, Unitize=False)  # -> Vector, Length; disabled
# 斑马线上的点在哪条斑马线
python_3_script_24 = Python3Script(points=point_33, curves=curve_28)  # -> a; inputs points: list of Point3d, curves: list of Curve; disabled; same code as python_3_script_13
cosine_6 = Cosine(Value=angle_6.Angle)  # disabled
number_slider_2 = Slider(0.667, range=0..1)  # disabled
absolute_6 = Absolute(Value=cosine_6)  # disabled
length_6 = Length(Curve=python_3_script_24)  # disabled
unit_vector_6 = UnitVector(Vector=vector_2pt_6.Vector)  # -> flatten(Vector); disabled
multiplication_16 = Multiplication(A=absolute_6, B=number_slider_2)  # disabled
multiplication_17 = Multiplication(A=multiplication_16, B=length_6)  # disabled
multiplication_18 = Multiplication(A=unit_vector_6, B=multiplication_17)  # disabled

move_6 = Move(Geometry=point_33, Motion=flatten(multiplication_18))  # -> Geometry, Transform; disabled
# 输出端
point_35 = Point(move_6.Geometry)  # disabled

# ----
# 输入端
# 输入端
# 道路中心点
# 输出端
point_36 = Point([<point referenced from the Rhino model> x511])
# 连续道路中心线
curve_32 = Curve([<curve referenced from the Rhino model> x2176])
# 斑马线
curve_33 = Curve([<curve referenced from the Rhino model> x1573])
# 断开道路中心线
curve_34 = Curve([<curve referenced from the Rhino model> x3675])
# 路网与斑马线交点
point_37 = Point([<point referenced from the Rhino model> x1620])
python_3_script_25 = Python3Script(intersection_points=point_37, centerlines=curve_34, crosswalks=curve_33)  # -> a; inputs intersection_points: list of Point3d, centerlines: list of Curve, crosswalks: list of Curve; disabled; same code as python_3_script_4
list_item_22 = ListItem(List=python_3_script_25, Index=0, Wrap=True)  # disabled
point_38 = Point(list_item_22)  # disabled
python_3_script_26 = Python3Script(a=python_3_script_25)  # -> junction, center, cross; inputs a: tree; disabled; same code as python_3_script_7
# （数据结构转换）
# 与道路中心点配对
python_3_script_27 = Python3Script(center_points=point_36, curves=curve_32, nearby_points=point_38)  # -> a; inputs center_points: list of Point3d, curves: list of Curve, nearby_points: list of Point3d; disabled
# ---------- python_3_script_27: Python ----------
import rhinoscriptsyntax as rs
import Grasshopper as gh


def find_points_on_intersecting_curves(center_points, curves, nearby_points):
    # 检查输入是否为 None
    if center_points is None or curves is None or nearby_points is None:
        return gh.DataTree[object]()

    result_tree = gh.DataTree[object]()
    tolerance = rs.UnitAbsoluteTolerance()  # 使用 Rhino 的绝对公差
    search_range = 300  # 设置搜索范围为 300 米

    for i, center_point in enumerate(center_points):
        intersecting_curves = []
        # 找到中心点周边一定范围内的曲线
        nearby_curves = []
        for curve in curves:
            curve_bbox = rs.BoundingBox(curve)
            if curve_bbox:
                # 检查曲线的边界框是否在中心点的搜索范围内
                min_point = curve_bbox[0]
                max_point = curve_bbox[6]
                if (
                    rs.Distance(center_point, min_point) <= search_range
                    or rs.Distance(center_point, max_point) <= search_range
                ):
                    nearby_curves.append(curve)

        # 找到与中心点相交的所有曲线
        for curve in nearby_curves:
            # 计算点到曲线的最近点
            param = rs.CurveClosestPoint(curve, center_point)
            if param is not None:
                closest_point = rs.EvaluateCurve(curve, param)
                # 判断点是否在曲线上，使用 Rhino 的绝对公差
                if rs.Distance(center_point, closest_point) < tolerance:
                    intersecting_curves.append(curve)

        # 存储在相交曲线上的附近点
        points_on_curves = []
        for curve in intersecting_curves:
            # 过滤出在搜索范围内的附近点
            filtered_nearby_points = [
                pt for pt in nearby_points if rs.Distance(pt, rs.CurveMidPoint(curve)) <= search_range
            ]
            for nearby_point in filtered_nearby_points:
                # 计算点到曲线的最近点
                param = rs.CurveClosestPoint(curve, nearby_point)
                if param is not None:
                    closest_point = rs.EvaluateCurve(curve, param)
                    # 判断点是否在曲线上，使用 Rhino 的绝对公差
                    if rs.Distance(nearby_point, closest_point) < tolerance:
                        points_on_curves.append(nearby_point)

        # 将结果添加到树中
        path = gh.Kernel.Data.GH_Path(i)
        result_tree.AddRange(points_on_curves, path)

    return result_tree


# Grasshopper 输入变量
# center_points 是路网中心点集
# curves 是路网曲线集
# nearby_points 是中心点附近的点集
# 输出变量为 result
result = find_points_on_intersecting_curves(center_points, curves, nearby_points)

# 赋值给 Grasshopper 输出
a = result
# ---------- end python_3_script_27 ----------
point_39 = Point(flatten(python_3_script_27))  # disabled

curve_35 = Curve(python_3_script_26.cross)  # disabled
curve_36 = Curve(python_3_script_26.center)  # disabled

# ----
# 中心点-斑马线上点-斑马线上点对应的两条线
# 四者顺序对应
member_index_7 = MemberIndex(Set=flatten(point_38), Member=point_39)  # -> simplify(Index), Count; disabled
list_item_23 = ListItem(List=flatten(curve_36), Index=flatten(member_index_7.Index), Wrap=True)  # disabled
list_item_24 = ListItem(List=flatten(curve_35), Index=flatten(member_index_7.Index), Wrap=True)  # disabled

# ----
# 向量计算
point_40 = Point(simplify(graft(point_36)))  # disabled
angle_7 = Angle(VectorA=list_item_24, VectorB=list_item_23)  # -> Angle, Reflex; disabled
vector_2pt_7 = Vector2Pt(PointA=point_40, PointB=python_3_script_27, Unitize=False)  # -> Vector, Length; disabled
# 斑马线上的点在哪条斑马线
python_3_script_28 = Python3Script(points=point_39, curves=curve_33)  # -> a; inputs points: list of Point3d, curves: list of Curve; disabled; same code as python_3_script_13
cosine_7 = Cosine(Value=angle_7.Angle)  # disabled
number_slider_3 = Slider(0.667, range=0..1)  # disabled
absolute_7 = Absolute(Value=cosine_7)  # disabled
length_7 = Length(Curve=python_3_script_28)  # disabled
unit_vector_7 = UnitVector(Vector=vector_2pt_7.Vector)  # -> flatten(Vector); disabled
multiplication_19 = Multiplication(A=absolute_7, B=number_slider_3)  # disabled
multiplication_20 = Multiplication(A=multiplication_19, B=length_7)  # disabled
multiplication_21 = Multiplication(A=unit_vector_7, B=multiplication_20)  # disabled

move_7 = Move(Geometry=point_39, Motion=flatten(multiplication_21))  # -> Geometry, Transform; disabled
# 输出端
point_41 = Point(move_7.Geometry)  # disabled

# ==== cluster Cluster
set_a = ClusterInput()
curve = ClusterInput()
end_points = EndPoints(Curve=curve)  # -> Start, End
point = Point([end_points.End, end_points.Start])
removeduplicatepts = RemoveDuplicatePts(Points=point, Tolerance=0.001)
set_difference = SetDifference(SetA=set_a, SetB=removeduplicatepts)
union = ClusterOutput(set_difference)
