# Grasshopper definition capture point offset_try3.gh (Grasshopper 1.0.8)
# plug-ins: RhinoCodePluginGH

# ----
# 道路中心点
# 斑马线
# 断开道路中心线
# 连续道路中心线
geometry_pipeline = GeometryPipeline(
    GroupByLayer=False,
    GroupByType=False,
    IncludeHidden=True,
    IncludeLocked=True,
    LayerFilter="roadcross",
    SublayerFiltering=True,
    TypeFilter=1)
geometry_pipeline_2 = GeometryPipeline(
    GroupByLayer=False,
    GroupByType=False,
    IncludeHidden=True,
    IncludeLocked=True,
    LayerFilter="zebra",
    SublayerFiltering=True,
    TypeFilter=4)
geometry_pipeline_3 = GeometryPipeline(
    GroupByLayer=False,
    GroupByType=False,
    IncludeHidden=True,
    IncludeLocked=True,
    LayerFilter="road2",
    SublayerFiltering=True,
    TypeFilter=4)
geometry_pipeline_4 = GeometryPipeline(
    GroupByLayer=False,
    GroupByType=False,
    IncludeHidden=True,
    IncludeLocked=True,
    LayerFilter="road",
    SublayerFiltering=True,
    TypeFilter=4)

# ----
# 取斑马线上的交点，并生成这些点由哪两条线相交
curve = Curve([geometry_pipeline_2, geometry_pipeline_3])

python_3_script = Python3Script(lines=curve)  # -> out, a, b; inputs lines: list of Curve
# ---------- python_3_script: Python ----------
import rhinoscriptsyntax as rs
import Grasshopper as gh

def find_line_intersections(lines):
    # 初始化输出
    intersection_points = []  # 交点列表
    intersection_indices = gh.DataTree[object]()  # 交点对应的线段索引

    # 检查每对线段的相交情况
    for i in range(len(lines)):
        for j in range(i + 1, len(lines)):
            line1 = lines[i]
            line2 = lines[j]

            # 计算线段所在直线的相交
            intersections = rs.CurveCurveIntersection(line1, line2)

            if intersections:
                for intersection in intersections:
                    point = intersection[1]
                    # 获取两条曲线的起点和终点
                    start1, end1 = rs.CurveStartPoint(line1), rs.CurveEndPoint(line1)
                    start2, end2 = rs.CurveStartPoint(line2), rs.CurveEndPoint(line2)

                    # 判断交点是否在两条线段的范围内
                    in_line1 = is_point_on_line_segment(point, start1, end1)
                    in_line2 = is_point_on_line_segment(point, start2, end2)

                    if in_line1 and in_line2:
                        # 检查交点是否重复
                        is_duplicate = False
                        for existing_pt in intersection_points:
                            if rs.Distance(point, existing_pt) < 1e-6:
                                is_duplicate = True
                                break

                        if not is_duplicate:
                            intersection_points.append(point)
                            # 创建分支路径并添加对应的线段索引
                            path = gh.Kernel.Data.GH_Path(len(intersection_points) - 1)
                            intersection_indices.AddRange([i, j], path)

    return intersection_points, intersection_indices

def is_point_on_line_segment(point, start, end):
    """
    判断点是否在线段上
    """
    # 计算点到线段起点和终点的距离之和
    dist_to_start = rs.Distance(point, start)
    dist_to_end = rs.Distance(point, end)
    line_length = rs.Distance(start, end)

    # 如果距离之和近似等于线段长度，则点在线段上
    return abs((dist_to_start + dist_to_end) - line_length) < 1e-6

# Grasshopper输入变量为 "lines"，类型为 Curve
# 输出变量为 "points" 和 "indices"
points, indices = find_line_intersections(lines)

# 赋值给Grasshopper输出
a = points  # 交点列表
b = indices  # 交点对应的线段索引树
# ---------- end python_3_script ----------
python_3_script_2 = Python3Script(x=geometry_pipeline_2, y=python_3_script.a)  # -> out, dot_product; inputs x: list of Curve, y: list of Point3d
# ---------- python_3_script_2: Python ----------
import Rhino.Geometry as rg
import math

# 输入参数
lines = x  # 线段列表
points = y  # 点列表
tolerance = 0.001

# 确保 points 是列表格式
if isinstance(points, rg.Point3d):
    points = [points]

result_points = []

for p in points:
    for line in lines:
        a = line.PointAtStart  # 线段起点
        b = line.PointAtEnd    # 线段终点
        
        # 计算向量AP和AB
        ap = p - a
        ab = b - a
        
        # 计算点积
        dot_product = ap * ab
        
        # 计算向量的模长
        ap_length = ap.Length
        ab_length = ab.Length
        
        # 计算理论上的最大点积
        max_dot_product = ap_length * ab_length
        
        # 判断点积是否接近于最大点积
        if abs(dot_product - max_dot_product) <= tolerance * max_dot_product and ab_length > tolerance:
            # 判断点是否在线段AB之间（点积在0到AB²之间）
            dot_ab_sq = ab * ab
            if 0 <= dot_product <= dot_ab_sq:
                result_points.append(p)  # 存储找到的点
                break  # 找到后跳出线段循环，避免重复添加

# 输出结果
out = result_points
# ---------- end python_3_script_2 ----------

# ----
# 去除斑马线端点
cluster = Cluster(set_a=python_3_script_2.out, curve=geometry_pipeline_2)
# 斑马线上的点
point = Point(cluster)

# ----
# 斑马线上点对应的两条线
list_item = ListItem(List=curve, Index=python_3_script.b, Wrap=True)
closest_point = ClosestPoint(Point=point, Cloud=python_3_script.a)  # -> ClosestPoint, CPIndex, Distance
tree_branch = TreeBranch(Tree=list_item, Path=flatten(closest_point.CPIndex), MaintainPaths=True)
list_item_2 = ListItem(List=tree_branch, Index=0, Wrap=True)  # -> flatten(Item), flatten(Item1)
curve_2 = Curve(list_item_2.Item1)
curve_3 = Curve(list_item_2.Item)

# ----
# （数据结构转换）
# 与道路中心点配对
python_3_script_3 = Python3Script(center_points=geometry_pipeline, curves=geometry_pipeline_4, nearby_points=closest_point.ClosestPoint)  # -> a; inputs center_points: list of Point3d, curves: list of Curve, nearby_points: list of Point3d
# ---------- python_3_script_3: Python ----------
import rhinoscriptsyntax as rs
import Grasshopper as gh


def find_points_on_intersecting_curves(center_points, curves, nearby_points):
    # 检查输入是否为 None
    if center_points is None or curves is None or nearby_points is None:
        return gh.DataTree[object]()

    result_tree = gh.DataTree[object]()

    for i, center_point in enumerate(center_points):
        intersecting_curves = []
        # 找到与中心点相交的曲线
        for curve in curves:
            # 计算点到曲线的最近点
            param = rs.CurveClosestPoint(curve, center_point)
            closest_point = rs.EvaluateCurve(curve, param)
            # 判断点是否在曲线上
            if rs.Distance(center_point, closest_point) < 1e-6:
                intersecting_curves.append(curve)
                if len(intersecting_curves) == 2:
                    break

        # 存储在相交曲线上的附近点
        points_on_curves = []
        for curve in intersecting_curves:
            for nearby_point in nearby_points:
                # 计算点到曲线的最近点
                param = rs.CurveClosestPoint(curve, nearby_point)
                closest_point = rs.EvaluateCurve(curve, param)
                # 判断点是否在曲线上
                if rs.Distance(nearby_point, closest_point) < 1e-6:
                    points_on_curves.append(nearby_point)

        # 将结果添加到树中
        path = gh.Kernel.Data.GH_Path(i)
        result_tree.AddRange(points_on_curves, path)

    return result_tree


# Grasshopper 输入变量
# center_points 是路网中心点集
# curves 是路网曲线集
# nearby_points 是中心点附近的点集
# 输出变量为 result
result = find_points_on_intersecting_curves(center_points, curves, nearby_points)

# 赋值给 Grasshopper 输出
a = result
# ---------- end python_3_script_3 ----------
panel = Panel(python_3_script_3)
point_2 = Point(flatten(python_3_script_3))

# ----
# 中心点-斑马线上点-斑马线上点对应的两条线
# 四者顺序对应
member_index = MemberIndex(Set=closest_point.ClosestPoint, Member=point_2)  # -> simplify(Index), Count
list_item_3 = ListItem(List=curve_3, Index=member_index.Index, Wrap=True)  # -> flatten(Item)
list_item_4 = ListItem(List=curve_2, Index=member_index.Index, Wrap=True)  # -> flatten(Item)

# ----
# 斑马线上的点在哪条斑马线
angle = Angle(VectorA=list_item_3, VectorB=list_item_4)  # -> Angle, Reflex
# 向量计算
point_3 = Point(graft(geometry_pipeline))
vector_2pt = Vector2Pt(PointA=point_3, PointB=python_3_script_3, Unitize=False)  # -> Vector, Length
python_3_script_4 = Python3Script(points=point_2, curves=geometry_pipeline_2)  # -> a; inputs points: list of Point3d, curves: list of Curve
# ---------- python_3_script_4: Python ----------
import rhinoscriptsyntax as rs
import Grasshopper as gh

def find_segment_for_each_point(points, curves):
    result_segments = []

    for point in points:
        found_segment = None
        for curve in curves:
            # 计算点到曲线的最近点
            param = rs.CurveClosestPoint(curve, point)
            closest_point = rs.EvaluateCurve(curve, param)
            # 判断点是否在曲线上
            if rs.Distance(point, closest_point) < 1e-6:
                found_segment = curve
                break

        result_segments.append(found_segment)

    return result_segments

# Grasshopper 输入变量
# points 是点集
# curves 是曲线集
# 输出变量为 result_segments
result_segments = find_segment_for_each_point(points, curves)

# 赋值给 Grasshopper 输出
a = result_segments
# ---------- end python_3_script_4 ----------
cosine = Cosine(Value=angle.Angle)
absolute = Absolute(Value=cosine)
length = Length(Curve=python_3_script_4)
unit_vector = UnitVector(Vector=vector_2pt.Vector)  # -> flatten(Vector)
multiplication = Multiplication(A=absolute, B=Slider(0.667, range=0..1))
multiplication_2 = Multiplication(A=multiplication, B=length)
multiplication_3 = Multiplication(A=unit_vector, B=multiplication_2)

move = Move(Geometry=point_2, Motion=flatten(multiplication_3))  # -> Geometry, Transform
# 输出端
point_4 = Point(move.Geometry)

# ==== cluster Cluster
set_a = ClusterInput()
curve = ClusterInput()
end_points = EndPoints(Curve=curve)  # -> Start, End
point = Point([end_points.End, end_points.Start])
removeduplicatepts = RemoveDuplicatePts(Points=point, Tolerance=0.001)
set_difference = SetDifference(SetA=set_a, SetB=removeduplicatepts)
union = ClusterOutput(set_difference)
